vi "imu_data_convert.gvi"   [LabVIEW NXG 1.0.0]
inputs:
  "input string": string
outputs:
  "imu data": T1
types:
  T1 = cluster{"accel x": i16, "accel y": i16, "accel z": i16, "gyro x": i16, "gyro y": i16, "gyro z": i16}
diagram:
  w1 = ["a-?[0-9]*", "b-?[0-9]*", "c-?[0-9]*", "d-?[0-9]*", "e-?[0-9]*", "f-?[0-9]*"]  # data patterns
  Array Size(array=w1) -> (size(s)=w2)
  w3 = [0, 0, 0, 0, 0, 0]  # data array
  w4 = 1  # value offset
  w5 = T1 {all zero or empty}  # data cluster
  Build Cluster($"input string", w3, w1, w4, w5) -> w6
  s1 = w6  # shift register
  for (N = w2) (iteration -> i1) {
    Property Node(instance in=s1) -> ("Element 1"=w7, "Element 3"=w8, "Element 4"=w9)
    # w7: input string
    Array Index(array=w8) -> (out0[i1]=w10)
    # w10: current data
    # element pattern
    # w9: value offset
    # s1: context
    Match Pattern(regular expression=w10, string=w7) -> (match substring=w11)
    w12 = 0  # int16 type val
    Decimal String To Number(default (0 I32)=w12, offset=w9, string=w11) -> (number=w13)
    Property Node(instance in=s1) -> ("Element 2"=w14)
    Replace Array Subset(inArray=w14, index=i1, new=w13) -> w15
    Property Node(instance in=s1, "Element 2"=w15) -> (instance out=w16)
    next s1 = w16
  }
  Property Node(instance in=s1) -> ("Element 5"=w17, "Element 2"=w18)
  Array Index(array=w18) -> (out0[0]=w19, out1[1]=w20, out2[2]=w21, out3[3]=w22, out4[4]=w23, out5[5]=w24)
  Property Node(instance in=w17, "accel x"=w19, "accel y"=w20, "accel z"=w21, "gyro x"=w22, "gyro y"=w23, "gyro z"=w24) -> (instance out=w25)
  $"imu data" <- w25
