vi "main.gvi"   [LabVIEW NXG 1.0.0]
panel controls:
  "stop": bool
  "max nr of bytes": u32 = 50
  "termination char": u8 = 13
  "COM": "Instr" = "COM3"
  "baud rate": u32 = 921600
  "Acquisition mode": i32
  "file name": string = "imu_data.txt"
  "Start": bool
  "MCU app mode": string = "0"
panel indicators:
  "data": string
  "accel x": i16
  "accel y": i16
  "accel z": i16
  "gyro x": i16
  "gyro y": i16
  "gyro z": i16
  "data len": i32
  "[packets/s]": i32
  "error out": error
  "Saving": bool
uses:
  NI::VISA::Open (Instr).gvi
  NI::VISA::Configure Serial Port (Instr).gvi
  NI::VISA::Write (Instr, String).gvi
  NI::VISA::Read (Instr, String).gvi
  NI::G Core::Timing::Elapsed Timer.gvi
  NI::G Core::Error::Is Error.gvi
  NI::VISA::Close (Instr).gvi
  NI::G Core::Error::Display Error.gvi
diagram:
  Get Component Directory() -> (Path=w1)
  Build Path(base path=w1, name or relative path=$"file name") -> (appended path=w2)
  Open Or Create Or Replace File(file path (use dialog)=w2, operation (0:open)="replace or create") -> (error out=w3, refnum out=w4)  # Open/Create/Replace File
  w5 = $"max nr of bytes"
  w6 = $COM
  while {
    stop if $Start
  }
  call "Open (Instr).gvi"(resource name=w6, error in=w3) -> (error out=w7, session out=w8)
  call "Configure Serial Port (Instr).gvi"(data bits=8, session in=w8, baud rate=$"baud rate", parity="None"(0), stop bits="1.0"(10), error in=w7, timeout=1000, termination char=$"termination char", enable termination char=TRUE, flow control="None"(0)) -> (session out=w9, error out=w10)
  call "Write (Instr, String).gvi"(session in=w9, error in=w10, write buffer=$"MCU app mode") -> (error out=w11, session out=w12)
  w13 = 0  # old i
  s1 = w13  # shift register
  while (iteration -> i1) {
    call "Read (Instr, String).gvi"(session in=w12, error in=w11, byte count=w5) -> (error out=w14, session out=w15, read buffer=w16)
    $data <- w16
    String Length(string=w16) -> (length=w17)
    $"data len" <- w17
    case ($"Acquisition mode") {
      frame 0, Default {
        # Display
        call "imu_data_convert.gvi"(input string=w16) -> (imu data=w22)
        Property Node(instance in=w22) -> ("accel x"=w23, "accel y"=w24, "accel z"=w25, "gyro x"=w26, "gyro y"=w27, "gyro z"=w28)
        $"accel x" <- w23
        $"accel y" <- w24
        $"accel z" <- w25
        $"gyro x" <- w26
        $"gyro y" <- w27
        $"gyro z" <- w28
        call "Elapsed Timer.gvi"(target time=1, reset=FALSE) -> (time has elapsed=w29)
        # Calculate packet rate
        case (w29) {
          frame False, Default {
            w18 = s1
          }
          frame True {
            Subtract(x=i1, y=s1) -> w30
            $"[packets/s]" <- w30
            w18 = i1
          }
        }
        w19 = w14
        w20 = w4
        w21 = FALSE
      }
      frame 1 {
        # Save
        Write To Text File(error in=w14, file (use dialog)=w4, text=w16) -> (error out=w19, refnum out=w20)
        $"error out" <- w19
        call "Is Error.gvi"(error in=w19) -> (error?=w31)
        Not(x=w31) -> w21
        w18 = i1
      }
    }
    Not(x=$stop) -> w32
    Logical And(w21, w32) -> w33
    $Saving <- w33
    call "Is Error.gvi"(error in=w19) -> (error?=w34)
    Logical Or(w34, $stop) -> w35
    next s1 = w18
    stop if w35
  }
  call "Close (Instr).gvi"(session in=w15, error in=w19) -> (error out=w36)
  Close File(error in=w36, refnum=w20) -> (error out=w37)
  call "Display Error.gvi"(error in=w37)
